vi "Index.gviweb"   [LabVIEW NXG 5.0.0]
panel controls:
  "Load Measurement Data from Skynet": bool
  "Skylink": string = "https://siasky.net/CAAjYi5kLZYyA-PAKmo3SkBS78zGee4FeQAUUm2EO-javA"
panel indicators:
  "Data": f64[][]
  "Raw Data": string[][]
uses:
  App::Simlate_Delay.gviweb
  NI::HTTP::Open HTTP Handle.gvi
  NI::HTTP::GET.gvi
  App::ConvertData.gviweb
  NI::HTTP::Close HTTP Handle.gvi
diagram:
  while {
    event {
      on "Load Measurement Data from Skynet" Value changed {
        w1 = 3000  # Simulate Load Delay (ms)
        Set Busy(reference in=reference to unnamed front panel, error in=no error) -> (reference out=w2, error out=w3)
        call "Simlate_Delay.gviweb"(milliseconds to wait=w1, Error In=w3) -> (Error Out=w4)
        call "Open HTTP Handle.gvi"(error in=w4) -> (client handle out=w5, error out=w6)
        call "GET.gvi"(client handle=w5, url=$Skylink, error in=w6) -> (client handle out=w7, body=w8, error out=w9)
        call "ConvertData.gviweb"(RawData=w8, GraphRef=reference to "Data", Error In=w9) -> (All Channels=w10, Data=w11, Error Out=w12)
        $Data <- w10
        $"Raw Data" <- w11
        call "Close HTTP Handle.gvi"(client handle=w7, error in=w9)
        Unset Busy(reference in=w2, error in=w12)
      }
    }
    stop if FALSE
  }
